# Grasshopper definition RL_Voxel_V1.gh (Grasshopper 1.0.8)
# plug-ins: RhinoCodePluginGH

# ----
# output_steps folder path
panel = Panel("C:\Users\user\Desktop\VS\RL_Voxel-Agent_PPO_V1\output_steps")

path = FilePath(panel)
py3 = Python3Script(path=path, frame=Slider(19, range=0..19))  # -> out, a
# ---------- py3: Python ----------
import Rhino.Geometry as rg
import json
import os

json_file = os.path.join(path, f"step_{int(frame):03}.json")

with open(json_file, 'r') as f:
    data = json.load(f)

voxels = data["voxels"]

boxes = []

grid_size = len(voxels)

for x in range(grid_size):
    for y in range(grid_size):
        for z in range(grid_size):
            if voxels[x][y][z] == 1:
                corner1 = rg.Point3d(x, y, z)
                corner2 = rg.Point3d(x + 1, y + 1, z + 1)
                bbox = rg.BoundingBox(corner1, corner2)
                box = rg.Box(bbox)
                boxes.append(box)

a = boxes
# ---------- end py3 ----------
